# Dynamo graph Generacion de planos.dyn "Planos-Jose" (Dynamo 2.13.1.3887)

# group: Seleccionamos el fichero excel con los planos
file_path = Filename("..\Planos.xlsx")
file_from_path = FileObject(path=file_path)
code_block = CodeBlock { "Planos"; }
importExcel = Data.ImportExcel(file=file_from_path, sheetName=code_block)

# group: Creacion del plano
restOfItems = List.RestOfItems(list=importExcel)
transpose = List.Transpose(lists=restOfItems)
code_block_2 = CodeBlock(a=transpose) { a[1]; }
code_block_3 = CodeBlock(a=transpose) { a[0]; }
family_types = FamilyTypes("A1 métrico:A1 métrico")
byNameNumberTitleBlock = Sheet.ByNameNumberTitleBlock(sheetName=code_block_2, sheetNumber=code_block_3, titleBlockFamilyType=family_types)

# group: Asignamos valores de los planos
code_block_4 = CodeBlock(a=importExcel) { a[0]; }
code_block_5 = CodeBlock { [0, 1]; }
removeItemAtIndex = List.RemoveItemAtIndex(list=code_block_4, indices=code_block_5)
removeItemAtIndex_2 = List.RemoveItemAtIndex(list=transpose, indices=code_block_5)
setParameterByName = Element.SetParameterByName(element=byNameNumberTitleBlock, parameterName=removeItemAtIndex@L1, value=removeItemAtIndex_2@L2)
